# Grasshopper definition Light_Sculpture_final.gh (Grasshopper 1.0.8)
# Copyright: 2017
# plug-ins: VirtualRobot.Grasshopper, Bifocals, LunchBox

pt = Point([Point(145.1931643, 0, -1.337440581), Point(116.8655763, 0, 69.79628041), Point(72.17093744, 0, 121.4154408), Point(2.296220366, 0, 155.4085464)])  # disabled
intcrv = Interpolate(Vertices=pt, Degree=3, Periodic=False, KnotStyle=1)  # -> Curve, Length, Domain; disabled
geo = Geometry(<brep referenced from the Rhino model>)  # disabled
crv = Curve(<curve referenced from the Rhino model>)  # disabled
number_slider = Slider(5, range=1..10)  # disabled
revsrf = Revolution(Curve=intcrv.Curve, Axis=crv, Domain=Domain(0, 6.283185307))  # disabled
number_slider_2 = Slider(3, range=1..3)  # disabled
number_slider_3 = Slider(3, range=1..3)  # disabled
viewer = ParamViewer()  # disabled
scale = Scale(Geometry=revsrf, Center=Point(0, 0, 0), Factor=number_slider)  # -> Geometry, Transform; disabled
diamond = DiamondPanels(Surface=scale.Geometry, UDivisions=number_slider_3, VDivisions=number_slider_2)  # -> DiamondPanels, TriPanels; disabled
panel = Panel("""0
1""")  # disabled
pt_2 = ConstructPoint(XCoordinate=panel, YCoordinate=0, ZCoordinate=0)  # disabled
number_slider_4 = Slider(31, range=1..101)  # disabled
iso = IsoCurve(UVPoint=pt_2)  # -> UIsocurve, VIsocurve; disabled
divide = DivideCurve(Curve=iso.UIsocurve, Count=number_slider_4, Kinks=False)  # -> Points, Tangents, Parameters; disabled
viewer_2 = ParamViewer(divide.Points)  # disabled
end = EndPoints(Curve=iso.VIsocurve)  # -> Start, End; disabled
panel_2 = Panel(divide.Points)  # disabled
pt_3 = Point(end.End)  # disabled
bang = ExplodeTree(Data=divide.Points)  # -> Branch0, Branch1; disabled
number_slider_5 = Slider(106, range=50..340)  # disabled
preview = CustomPreview(
    Geometry=bang.Branch0,
    Material={diffuse=RGB(228, 178, 227), emission=RGB(68, 53, 68), shine=0.5, specular=RGB(255, 254, 254), transparency=0})  # disabled
xy = XYPlane(Origin=Point(0, 0, 0))  # disabled
number_slider_6 = Slider(8, range=1..20)  # disabled
panel_3 = Panel(bang.Branch0)  # disabled
vec2pt = Vector2Pt(PointA=xy, PointB=bang.Branch0, Unitize=False)  # -> Vector, Length; disabled
ln = Line(StartPoint=bang.Branch0, EndPoint=end.End)  # disabled
number_slider_7 = Slider(0.5, range=0.1..0.9)  # disabled
number_slider_8 = Slider(1, range=1..2)  # disabled
py3 = Python3Script(P=end.End, L=bang.Branch0, num_points=number_slider_5, num_rotations=number_slider_6)  # -> out, a; inputs P: Point3d, L: list of Point3d, dome: GeometryBase; disabled
# ---------- py3: Python ----------
import Rhino.Geometry as rg
import math
import scriptcontext as sc
import System

a = []

# --- Handle dome input ---
if isinstance(dome, System.Guid):
    geom = sc.doc.Objects.Find(dome).Geometry
else:
    geom = dome

if isinstance(geom, rg.Brep):
    dome_srf = geom.Faces[0]
elif isinstance(geom, rg.Surface):
    dome_srf = geom
else:
    raise TypeError("Dome must be a Surface or Brep")

num_points = 300
num_rotations = 5
top_point = P
base_pts = L

# Dome center approximation
center_x = sum([pt.X for pt in base_pts]) / len(base_pts)
center_y = sum([pt.Y for pt in base_pts]) / len(base_pts)
center = rg.Point3d(center_x, center_y, 0)

# Approximate mean radius
radii = [rg.Vector3d(pt.X - center.X, pt.Y - center.Y, 0).Length for pt in base_pts]
r = sum(radii) / len(radii)

# Spiral points
spiral_pts = []

base_z = sum([pt.Z for pt in base_pts]) / len(base_pts)

for i in range(num_points + 1):
    t = i / float(num_points)
    z = top_point.Z + t * (base_z - top_point.Z)
    theta = t * num_rotations * 2 * math.pi
    r_scaled = t * r
    x = center.X + r_scaled * math.cos(theta)
    y = center.Y + r_scaled * math.sin(theta)

    # Project onto dome surface
    closest_param = dome_srf.ClosestPoint(rg.Point3d(x, y, z))
    pt_on_surf = dome_srf.PointAt(closest_param[0], closest_param[1])
    spiral_pts.append(pt_on_surf)

if len(spiral_pts) > 1:
    spiral_curve = rg.NurbsCurve.Create(False, 3, spiral_pts)
    a.append(spiral_curve)
# ---------- end py3 ----------
crv_2 = Curve(py3.a)  # disabled
amp = Amplitude(Vector=vec2pt.Vector, Amplitude=number_slider_8)  # disabled
number_slider_9 = Slider(20, range=20..100)  # disabled
py3_2 = Python3Script(P0=end.End, Pts=bang.Branch0, strength=number_slider_7)  # -> out, a; inputs P0: Point3d, Pts: list of Point3d; disabled
# ---------- py3_2: Python ----------
import Rhino.Geometry as rg

curves = []

for pt in Pts:

    # midpoint between top point and target point
    mid = rg.Point3d((P0.X + pt.X)/2, (P0.Y + pt.Y)/2, (P0.Z + pt.Z)/2)

    # vector outward from center (top point)
    v = mid - P0
    v.Unitize()
    v *= strength  # how much the curve bends outward

    # outward-bulged midpoint
    bend_pt = mid + v

    # create a 3-point arc or interpolated curve
    crv = rg.Arc(P0, bend_pt, pt).ToNurbsCurve()

    curves.append(crv)

a = curves
# ---------- end py3_2 ----------
multiplication = Multiplication(A=amp, B=number_slider_9)  # disabled
arc = ArcSED(Start=end.End, End=bang.Branch0, Direction=multiplication)  # -> Arc, Plane, Radius; disabled

pt_4 = Point()  # disabled
diamond_2 = DiamondPanels(UDivisions=10, VDivisions=10)  # -> DiamondPanels, TriPanels; disabled
crv_3 = Curve(<curve referenced from the Rhino model>)  # disabled
midpt = CurveMiddle(Curve=crv_3)  # disabled
pt_5 = Point(midpt)  # disabled

xy_2 = XYPlane(Origin=Point(0, 0, 0))
dom²num = ConstructDomain²(UMin=Slider(0, range=0..1), UMax=Slider(1, range=0..1), VMin=Slider(0.5, range=0..1), VMax=Slider(1, range=0..1))
sph = Sphere(Base=xy_2, Radius=Slider(550, range=100..600))
subsrf = Isotrim(Surface=reparameterize(sph), Domain=dom²num)

# ---- group: Base
xy_3 = XYPlane(Origin=Point(0, 0, 0))
yz = YZPlane(Origin=Point(0, 0, 0))
cyl = Cylinder(Base=xy_3, Radius=Slider(220, range=100..300), Length=Slider(875, range=100..2000))
rotate = Rotate(Geometry=cyl, Angle=Slider(6.283, range=0..6.283), Plane=yz)  # -> Geometry, Transform
Z = UnitZ(Factor=1)
multiplication_2 = Multiplication(A=Z, B=Slider(-836, range=-1000..1000))
move = Move(Geometry=rotate.Geometry, Motion=multiplication_2)  # -> Geometry, Transform
py3_3 = Python3Script(
    srf=move.Geometry,
    amp=Slider(38, range=20..60),
    freq=Slider(1, range=1..20),
    turns=Slider(25, range=10..100),
    points=Slider(515, range=200..1000))  # -> out, curve; inputs srf: Surface, points: Int32
# ---------- py3_3: Python ----------
"""Grasshopper Script"""
import Rhino.Geometry as rg
import math

# Get surface domain
u_dom = srf.Domain(0)
v_dom = srf.Domain(1)

pts = []

for i in range(points):
    t = float(i) / (points - 1)

    # Wrap around cylinder (U)
    u = u_dom.T0 + t * (u_dom.T1 - u_dom.T0) * turns

    # Move up cylinder (V)
    v = v_dom.T0 + t * (v_dom.T1 - v_dom.T0)

    # Sine offset in U direction
    sine = math.sin(t * freq * 2 * math.pi)

    # Base point on surface
    pt = srf.PointAt(u, v)

    # Surface normal (points outward)
    normal = srf.NormalAt(u, v)
    normal.Unitize()

    # Offset point outward
    pt += normal * sine * amp

    pts.append(pt)

curve = rg.Curve.CreateInterpolatedCurve(pts, 3)
# ---------- end py3_3 ----------
srf = Surface(move.Geometry)
crv_4 = Curve(py3_3.curve)

# ----
py3_4 = Python3Script(srf=subsrf, turns=Slider(25, range=10..100), points=Slider(290, range=200..1000))  # -> out, curve; inputs srf: Surface, points: Int32
# ---------- py3_4: Python ----------
import Rhino.Geometry as rg
import math

# Get surface domain
u_dom = srf.Domain(0)
v_dom = srf.Domain(1)

pts = []

for i in range(points):
    t = float(i) / (points - 1)

    # U wraps around cylinder
    u = u_dom.T0 + t * turns * (u_dom.T1 - u_dom.T0)

    # V moves along height
    v = v_dom.T0 + t * (v_dom.T1 - v_dom.T0)

    pt = srf.PointAt(u, v)
    pts.append(pt)

curve = rg.Curve.CreateInterpolatedCurve(pts, 3)
# ---------- end py3_4 ----------
crv_5 = Curve(py3_4.curve)

end_2 = EndPoints(Curve=crv_5)  # -> Start, End
pt_6 = Point(end_2.Start)
end_3 = EndPoints(Curve=crv_4)  # -> Start, End
pt_7 = Point(end_3.End)
ln_2 = Line(StartPoint=pt_7, EndPoint=pt_6)

pt_8 = Point(<point referenced from the Rhino model>)
vec = VectorXYZ(
    XComponent=Slider(-71.599, range=-180..180),
    YComponent=Slider(-5.847, range=-180..180),
    ZComponent=Slider(24.332, range=-180..180))  # -> Vector, Length
panel_4 = Panel(vec.Vector)
merge = Merge(Data1=crv_5, Data2=crv_4, Data3=ln_2)  # -> flatten(Result)
sframe = SetFrame(XYZLocation=pt_8, ABCOrientation=vec.Vector)
loft = Loft(Curves=merge, Options={Adjust=False, Closed=False, LoftEnds=0, LoftSimp=0, LoftType=0, Rebuild=10, Refit=0.01})  # disabled
join = JoinCurves(Curves=merge, Preserve=False)
crv_6 = Curve(join)
orient = Orient(Geometry=crv_6, Source=PlaneXY(0, 0, 0), Target=sframe)  # -> Geometry, Transform
srf_2 = Surface(loft)  # disabled
divide_2 = DivideCurve(Curve=orient.Geometry, Count=Slider(1000, range=50..1000), Kinks=False)  # -> Points, Tangents, Parameters
xy_4 = XYPlane(Origin=Point(0, 0, 0))
pline = PolyLine(Vertices=divide_2.Points, Closed=False)
vec2pt_2 = Vector2Pt(PointA=xy_4, PointB=divide_2.Points, Unitize=False)  # -> Vector, Length
yz_2 = YZPlane(Origin=divide_2.Points)
panel_5 = Panel(yz_2)
panel_6 = Panel(vec2pt_2.Vector)
pline_2 = PolyLine(Vertices=yz_2, Closed=False)
len = Length(Curve=pline_2)
panel_7 = Panel(len)
preview_2 = CustomPreview(Geometry=pline_2, Material=ColourSwatch(SwatchColor=RGB(138, 220, 255)))  # disabled

number_slider_10 = Slider(31.532, range=-180..180)  # disabled
number_slider_11 = Slider(-138.919, range=-180..180)  # disabled
number_slider_12 = Slider(-8.247, range=-180..180)  # disabled
pt_9 = Point(<point referenced from the Rhino model>)  # disabled
vec_2 = VectorXYZ(XComponent=number_slider_11, YComponent=number_slider_12, ZComponent=number_slider_10)  # -> Vector, Length; disabled
panel_8 = Panel(vec_2.Vector)  # disabled
sframe_2 = SetFrame(XYZLocation=pt_9, ABCOrientation=vec_2.Vector)  # disabled
orient_2 = Orient(Geometry=crv_4, Source=PlaneXY(0, 0, 0), Target=sframe_2)  # -> flatten(Geometry), Transform; disabled
number_slider_13 = Slider(293, range=50..1000)  # disabled
divide_3 = DivideCurve(Curve=orient_2.Geometry, Count=number_slider_13, Kinks=False)  # -> Points, Tangents, Parameters; disabled
xy_5 = XYPlane(Origin=Point(0, 0, 0))  # disabled
pline_3 = PolyLine(Vertices=divide_3.Points, Closed=False)  # disabled
vec2pt_3 = Vector2Pt(PointA=xy_5, PointB=divide_3.Points, Unitize=False)  # -> Vector, Length; disabled
yz_3 = YZPlane(Origin=divide_3.Points)  # disabled
panel_9 = Panel(yz_3)  # disabled
panel_10 = Panel(vec2pt_3.Vector)  # disabled
pline_4 = PolyLine(Vertices=yz_3, Closed=False)  # disabled
len_2 = Length(Curve=pline_4)  # disabled
swatch = ColourSwatch(SwatchColor=RGB(71, 18, 255))  # disabled
panel_11 = Panel(len_2)  # disabled
preview_3 = CustomPreview(Geometry=pline_4, Material=swatch)

number_slider_14 = Slider(31.532, range=-180..180)  # disabled
number_slider_15 = Slider(-138.919, range=-180..180)  # disabled
number_slider_16 = Slider(-8.247, range=-180..180)  # disabled
pt_10 = Point(<point referenced from the Rhino model>)  # disabled
vec_3 = VectorXYZ(XComponent=number_slider_15, YComponent=number_slider_16, ZComponent=number_slider_14)  # -> Vector, Length; disabled
panel_12 = Panel(vec_3.Vector)  # disabled
sframe_3 = SetFrame(XYZLocation=pt_10, ABCOrientation=vec_3.Vector)  # disabled
orient_3 = Orient(Geometry=crv_5, Source=PlaneXY(0, 0, 0), Target=sframe_3)  # -> flatten(Geometry), Transform; disabled
number_slider_17 = Slider(293, range=50..1000)  # disabled
divide_4 = DivideCurve(Curve=orient_3.Geometry, Count=number_slider_17, Kinks=False)  # -> Points, Tangents, Parameters; disabled
xy_6 = XYPlane(Origin=Point(0, 0, 0))  # disabled
pline_5 = PolyLine(Vertices=divide_4.Points, Closed=False)  # disabled
vec2pt_4 = Vector2Pt(PointA=xy_6, PointB=divide_4.Points, Unitize=False)  # -> Vector, Length; disabled
yz_4 = YZPlane(Origin=divide_4.Points)  # disabled
panel_13 = Panel(yz_4)  # disabled
panel_14 = Panel(vec2pt_4.Vector)  # disabled
pline_6 = PolyLine(Vertices=yz_4, Closed=False)  # disabled
len_3 = Length(Curve=pline_6)  # disabled
swatch_2 = ColourSwatch(SwatchColor=RGB(249, 0, 92))  # disabled
panel_15 = Panel(len_3)  # disabled
preview_4 = CustomPreview(Geometry=pline_6, Material=swatch_2)

align = AlignPlane(Plane=yz_2, Direction=vec2pt_2.Vector)  # -> Plane, Angle

# ---- group: Top Trial
tread = Slider(2.751, range=0..3)  # disabled
width = Slider(4.486, range=0..10)  # disabled
riser = Slider(0.042, range=0..1)  # disabled

# ----
rotate_2 = Rotate(Geometry=align.Plane, Angle=degrees(Slider(0, range=-180..180)), Plane=align.Plane)  # -> Geometry, Transform

# ---- group: Top Trial
number_slider_18 = Slider(50, range=0..100)  # disabled
pt_11 = Point(Point(0, 0, 0))  # disabled
number_slider_19 = Slider(100, range=0..100)  # disabled
pt_12 = Point(Point(1, 0, 0))  # disabled
pt_13 = Point(Point(1, 0, 0))  # disabled
panel_16 = Panel("0")  # disabled
sph_2 = Sphere(Base=PlaneXY(0, 0, 0), Radius=number_slider_18)  # disabled
pl_3pt = Plane3Pt(PointA=pt_11, PointB=pt_12, PointC=pt_13)  # disabled
pln = Plane(Plane(origin=(-0.05646588049, 0.5166577335, 0), x=(0.9520932791, -0.01744804712, 0.3053096029), y=(-0.01832290842, -0.9998321214, 0)))  # disabled
xy_7 = XYPlane(Origin=pl_3pt)  # disabled
Z_2 = UnitZ(Factor=number_slider_19)  # disabled
pxs = PlaneThroughShape(Plane=xy_7, Shape=sph_2, Inflate=1, SectionLogic=False)  # disabled
move_2 = Move(Geometry=pxs, Motion=Z_2)  # -> Geometry, Transform; disabled
division = Division(A=width, B=2)  # disabled
splitmul = SplitBrepMultiple(Brep=sph_2, Cutters=[move_2.Geometry, pxs])  # disabled
number_slider_20 = Slider(11, range=5..20)  # disabled
X = UnitX(Factor=1)  # disabled
srf_sl = SrfSmallLarge(srf_list=splitmul)  # -> smallest, largest; disabled
contour = Contour(Shape=srf_sl.largest, Point=Point(0, 0, 0), Direction=Vector(0, 0, 1), Distance=riser)  # -> flatten(Contours); disabled
shift = ShiftList(List=contour, Shift=1, Wrap=invert(True))  # disabled
end_4 = EndPoints(Curve=shift)  # -> Start, End; disabled
pdecon = Deconstruct(Point=end_4.Start)  # -> XComponent, YComponent, ZComponent; disabled
pt_14 = ConstructPoint(XCoordinate=0, YCoordinate=0, ZCoordinate=pdecon.ZComponent)  # disabled
dist = Distance(PointA=end_4.Start, PointB=pt_14)  # disabled
addition = Addition(A=dist, B=division)  # disabled
division_2 = Division(A=tread, B=addition)  # disabled
line = LineSDL(Start=end_4.Start, Direction=X, Length=width)  # disabled
atan = ArcTangent(Value=division_2)  # -> flatten(Result); disabled
brep = Brep(srf_sl.largest)  # disabled
ma = MassAddition(Input=atan)  # -> Result, PartialResults; disabled
ins = InsertItems(List=ma.PartialResults, Item=panel_16, Indices=panel_16, Wrap=True)  # disabled
shift_2 = ShiftList(List=ins, Shift=-1, Wrap=invert(True))  # disabled
rotate_3 = Rotate(Geometry=line, Angle=shift_2, Plane=PlaneXY(0, 0, 0))  # -> Geometry, Transform; disabled
end_5 = EndPoints(Curve=rotate_3.Geometry)  # -> Start, End; disabled
intcrv_2 = Interpolate(Vertices=end_5.Start, Degree=3, Periodic=False, KnotStyle=1)  # -> Curve, Length, Domain; disabled
scale_2 = Scale(Geometry=intcrv_2.Curve, Center=Point(0, 0, 0), Factor=number_slider_20)  # -> Geometry, Transform; disabled
pi = Pi(Factor=1)  # disabled
panel_17 = Panel(pi)  # disabled
yz_5 = YZPlane(Origin=Point(0, 0, 0))  # disabled
rotate_4 = Rotate(Geometry=scale_2.Geometry, Angle=pi, Plane=yz_5)  # -> Geometry, Transform; disabled
crv_7 = Curve(rotate_4.Geometry)  # disabled

# ----
deplane = DeconstructPlane(Plane=rotate_2.Geometry)  # -> Origin, XAxis, YAxis, ZAxis
line_2 = LineSDL(Start=deplane.Origin, Direction=deplane.YAxis, Length=1)
rotax = RotateAxis(Geometry=rotate_2.Geometry, Angle=degrees(Slider(0, range=-180..180)), Axis=line_2)  # -> Geometry, Transform

# ----
# Goal Planes
geometry = Geometry(rotax.Geometry)

trigger = Trigger(Interval=20, TimerInterval=20, Target=iframe)

# ----
# ROBOT DEFINITION
xy_8 = XYPlane(Origin=Point(0, 0, 0))

# ---- group: KR 30 HA
cluster = Cluster_2(robroot=xy_8)

# ----
addition_2 = Addition(A=panel_11, B=panel_15)  # disabled
merge_2 = Merge(Data1=pline_4, Data2=pline_6)  # disabled
panel_18 = Panel(addition_2)  # disabled
python_3_script = Python3Script()  # -> out, fileName
# ---------- python_3_script: Python ----------
path = ghdoc.Path
a = path.split('\\')
fileName = a[-1].split(".")[0]
# ---------- end python_3_script ----------
advance = Slider(3, range=1..5)

pipe = Pipe(Radius=Slider(3, range=0..10), Caps=0, FitRail=False)

# ----
# KRL Settings
file_path = Panel("C:\Users\sangy\Downloads")
home_position = Panel("{A1 0, A2 -120, A3 120, A4 0, A5 -20, A6 0, E1 0, E2 0, E3 0, E4 0, E5 0, E6 0}")
home_position_2 = Panel("$POS_ACT")
lng = ListLength(List=geometry)
range = Range(Domain=Domain(0, 1), Steps=expr("x-1", lng))
xy_9 = XYPlane(Origin=Point(0, 0, 0))
velocity_ptp = Slider(73, range=0..100)
velocity_cp_m_s = Slider(0.91, range=0..2)
job_name = Panel(python_3_script.fileName)
base = Slider(1, range=1..2)
tool = Slider(1, range=1..2)
graph = GraphMapper(range, x0=0, x1=1, y0=0, y1=1, container_name="Sine", Equation_px=[0, 0.2230277658], Equation_py=[0.190113008, 1])
pln_2 = Plane(xy_9)
python_3_script_2 = Python3Script(iFileName="CompDes_Ex", iFilePath=file_path)  # -> oFileNameLength, oFilePath; inputs iFileName: String, iFilePath: String
# ---------- python_3_script_2: Python ----------
import Grasshopper.Kernel as gh

e = gh.GH_RuntimeMessageLevel.Error
w = gh.GH_RuntimeMessageLevel.Warning
oFileNameLength = len(iFileName)
if len(iFileName) > 24:
    ghenv.Component.AddRuntimeMessage(e, "File name exceeds 25 characters. Current length: " + str(len(iFileName)))
else:
    oFilePath = iFilePath + iFileName
# ---------- end python_3_script_2 ----------
krl_settings = Python3Script(
    name="CompDes_Ex",
    home=home_position,
    vel_cp=velocity_cp_m_s,
    vel_ptp=velocity_ptp,
    tool=tool,
    base=pln_2,
    advance=advance)  # -> out, a; inputs name: String, home: String, vel_cp: Double, vel_ptp: Double, tool: Int32, base: Plane, advance: Int32
# ---------- krl_settings: Python ----------
class Plane:
    # Placeholder class for Plane, replace with actual implementation if available.
    pass

class RobotSettings:
    def __init__(self):
        self._name = None
        self._home = None
        self._velcp = None
        self._velptp = None
        self._tool = None
        self._base = None
        self.advance = None

    # ##### PROPERTIES #####

    @property
    def name(self):
        return self._name

    @name.setter
    def name(self, value):
        self._name = value

    @property
    def home(self):
        return self._home

    @home.setter
    def home(self, value):
        self._home = value

    @property
    def vel_cp(self):
        return self._velcp

    @vel_cp.setter
    def vel_cp(self, value):
        self._velcp = value

    @property
    def vel_ptp(self):
        return self._velptp

    @vel_ptp.setter
    def vel_ptp(self, value):
        self._velptp = value

    @property
    def tool(self):
        return self._tool

    @tool.setter
    def tool(self, value):
        self._tool = value

    @property
    def base(self):
        return self._base

    @base.setter
    def base(self, value):
        self._base = value

    @property
    def advance(self):
        return self._advance

    @advance.setter
    def advance(self, value):
        self._advance = value

def run_script(name, home, vel_cp, vel_ptp, tool, base, advance):
    """
    Function to configure robot settings.
    Args:
        name (str): Name of the robot program.
        home (str): Home position.
        vel_cp (float): Continuous path velocity.
        vel_ptp (float): Point-to-point velocity.
        tool (int): Tool number.
        base (Plane): Base plane.
    Returns:
        RobotSettings: Configured robot settings.
    """
    # Step 1: Create a new RobotSettings object
    settings = RobotSettings()

    # Step 2: Assign values to the settings
    settings.name = name
    settings.home = home
    settings.vel_cp = vel_cp
    settings.vel_ptp = vel_ptp
    settings.tool = tool
    settings.base = base
    if advance:
        settings.advance = advance
    else:
        settings.advance = 3

    # Return the settings object
    return settings
a = run_script(name, home, vel_cp, vel_ptp, tool, base, advance)
print(a.advance)
# ---------- end krl_settings ----------
panel_19 = Panel(python_3_script_2.oFilePath)
remap = RemapNumbers(Value=graph, Source=Domain(0, 1), Target="0.2 to 0.8")  # -> Mapped, Clipped

# ---- group: export
enable = BooleanToggle(True)
export = Button()

# ----
panel_20 = Panel(python_3_script_2.oFileNameLength)

# ---- group: axis check
list = ValueList({"One": "False,False,False", "Two": "True,False,False", "Three": "False,True,False", "Four": "True,True,False", "Five": "False,False,True", "Six": "True,False,True", "Seven": "False,True,True", "Eight": "True,True,True"}, selected="One")
split = TextSplit(Text=list, Separators=",")
all_planes = Plane(geometry)
robot_ik = RobotInverseKinematics(Robot=cluster, TargetTCPFrame=all_planes, AxisToggles=split, useColorPreview=True)  # -> PoseGeometry, AxisValues, AxisFrames
item = ListItem(List=robot_ik.AxisValues, Index=0, Wrap=True)  # -> Item, Item1, Item2, Item3, Item4, Item5
dom = ConstructDomain(DomainStart=Slider(-350, range=-360..360), DomainEnd=Slider(350, range=-360..360))
dom_2 = ConstructDomain(DomainStart=Slider(-350, range=-360..360), DomainEnd=Slider(350, range=-360..360))
dom_3 = ConstructDomain(DomainStart=Slider(-119, range=-360..360), DomainEnd=Slider(119, range=-360..360))
dom_4 = ConstructDomain(DomainStart=Slider(-185, range=-360..360), DomainEnd=Slider(185, range=-360..360))
dom_5 = ConstructDomain(DomainStart=Slider(-120, range=-360..360), DomainEnd=Slider(158, range=-360..360))
dom_6 = ConstructDomain(DomainStart=Slider(-135, range=-360..360), DomainEnd=Slider(35, range=-360..360))
inc = Includes(Value=item.Item, Domain=dom_4)  # -> Includes, Deviation
panel_21 = Panel(robot_ik.AxisValues)
inc_2 = Includes(Value=item.Item1, Domain=dom_6)  # -> Includes, Deviation
inc_3 = Includes(Value=item.Item2, Domain=dom_5)  # -> Includes, Deviation
inc_4 = Includes(Value=item.Item4, Domain=dom_3)  # -> Includes, Deviation
inc_5 = Includes(Value=item.Item3, Domain=dom_2)  # -> Includes, Deviation
inc_6 = Includes(Value=item.Item5, Domain=dom)  # -> Includes, Deviation
panel_22 = Panel(item.Item)
and = GateAnd(A=inc.Includes, B=inc_2.Includes, C=inc_3.Includes, D=inc_5.Includes, E=inc_4.Includes, F=inc_6.Includes)
number_slider_21 = Slider(1, range=0..1)
cull = CullPattern(List=all_planes, CullPattern=flatten(and))
# If TRUE all points are reacheable by the robot
py3_5 = Python3Script(x=flatten(and))  # -> out, a, b; inputs x: list
# ---------- py3_5: Python ----------
"""Grasshopper Script"""

# Flatten input
flat = []
for item in x:
    if isinstance(item, list):
        flat.extend(item)
    else:
        flat.append(item)

# Convert to booleans and check
all_true = all(bool(v) for v in flat)
has_false = not all_true

# Outputs
a = has_false      # True if ANY False exists
b = all_true       # True if ALL values are True
# ---------- end py3_5 ----------
panel_23 = Panel(and)
panel_24 = Panel(py3_5.b)

# ----
iframe = InterpolateFrames(Frames=cull, Length=Slider(0.69, range=0..0.999), Step="20", Reset=Toggle(False))  # -> Frame, Percent, CurrentIndex

# ----
# IK SIMULATION
list_2 = ValueList({"One": "False,False,False", "Two": "True,False,False", "Three": "False,True,False", "Four": "True,True,False", "Five": "False,False,True", "Six": "True,False,True", "Seven": "False,True,True", "Eight": "True,True,True"}, selected="One")
split_2 = TextSplit(Text=list_2, Separators=",")
pln_3 = Plane(iframe.Frame)
data = Data(cluster)
robot_ik_2 = RobotInverseKinematics(Robot=data, TargetTCPFrame=pln_3, AxisToggles=split_2, useColorPreview=True)  # -> PoseGeometry, AxisValues, AxisFrames

panel_25 = Panel(robot_ik_2.AxisValues)

# ----
# Visualisation of axis limits (MP)
pt_15 = Point(Point(169.7745377, -3441.060046, 0))
num = Number(robot_ik_2.AxisValues)
cluster_2 = Cluster(pt=pt_15, num=num)  # -> G, crv_2, line_3, geometry, a, colour
swatch_3 = ColourSwatch(SwatchColor=RGB(255, 255, 255))
tag = TextTag3D(Location=cluster_2.G, Text=graft(num), Size=Slider(70, range=0..100), Colour=swatch_3, Justification=cluster_2.a)
preview_5 = CustomPreview(Geometry=[cluster_2.crv_2, cluster_2.line_3], Shader=swatch_3)
preview_6 = CustomPreview(Geometry=cluster_2.geometry, Shader=cluster_2.colour)

# ----
# Path simulation
division_3 = Division(A=iframe.Percent, B=100)
subcrv = SubCurve(BaseCurve=reparameterize(pline_2), Domain=division_3)
preview_7 = CustomPreview(Geometry=subcrv, Material=ColourSwatch(SwatchColor=RGB(254, 87, 225)))

# ----
# Color simulation
wa = CSharpScript(M=robot_ik_2.PoseGeometry)  # -> out, M_fixed; inputs M: list
# ---------- wa: C# usings ----------
using System.Threading.Tasks;
# ---------- wa: C# ----------
    if (M == null) return;
    var objects = new System.Object[M.Count];
    //var tol = RhinoDoc.ActiveDoc.ModelAbsoluteTolerance;
    Parallel.For(0, M.Count, i =>
      {
      // Try to fix only the meshes
      if (M[i] is Mesh)
      {
        var mesh = (Mesh) M[i];
        mesh = mesh.DuplicateMesh();
        /*
        Attempts to remove degenerate faces from the mesh. Degenerate
        faces are faces that contains such a combination of indices,
        that their final shape collapsed in a line or point.
        */
        mesh.Faces.CullDegenerateFaces();
        /*
        The operation "AlignVertices" is way too slow for use
        for only fixing preview of bad meshing, so skip it as
        a workaround.
        */
        //mesh.Vertices.Align(tol * 100, null);
        objects[i] = mesh;
      }
      else
        objects[i] = M[i];
      });
    M_fixed = objects;
# ---------- end wa ----------
panel_26 = Panel("""1
1
1
0
0
0
1
1
1
1
0
0
1""")
split_3 = SplitList(List=wa.M_fixed, Index=13)  # -> ListA, ListB
dispatch = Dispatch(List=split_3.ListA, DispatchPattern=panel_26)  # -> ListA, ListB
preview_8 = CustomPreview(Geometry=dispatch.ListA, Material=ColourSwatch(SwatchColor=RGB(0, 0, 0)))
preview_9 = CustomPreview(Geometry=dispatch.ListB, Material=ColourSwatch(SwatchColor=RGB(194, 93, 10)))
preview_10 = CustomPreview(Geometry=split_3.ListB, Material=ColourSwatch(SwatchColor=RGB(156, 156, 156)))

# ----
# KRL-Code generation
list_3 = ValueList({"", "C_DIS", "C_VEL"}, selected="")
data_2 = Data(krl_settings.a)
pln_4 = Plane(geometry)
krl_generation = Python3Script(iPlanes=pln_4, iSettings=data_2, iCont=list_3)  # -> out, a; inputs iPlanes: tree of Plane, iSpeed: list of Double, iCont: String
# ---------- krl_generation: Python ----------
import math
import Rhino.Geometry as rg

class KRLCode:
    def __init__(self, s):
        self.code = []
        self.r = 3
        self.name = s.name
        self.home = s.home
        self.vel_cp = s.vel_cp
        self.vel_ptp = s.vel_ptp
        self.tool = s.tool
        self.base = s.base
        self.advance = s.advance

    def header(self):
        self.code.append("&ACCESS RVP")
        self.code.append("&REL 1")
        self.code.append("&PARAM TEMPLATE = C:\\KRC\\Roboter\\Template\\vorgabe")
        self.code.append("&PARAM EDITMASK = *")
        self.code.append(f"DEF {self.name}()")

    def decl(self):
        self.code.append("\n;------- Declaration section -------")
        if self.home == "$POS_ACT":
            self.code.append("DECL E6POS HOME")
        else:
            self.code.append("DECL E6AXIS HOME")

    def init(self):
        xyz = self.get_xyz(self.base)
        abc = self.get_abc(self.base)

        g = f"X {round(xyz[0], self.r)}, Y {round(xyz[1], self.r)}, Z {round(xyz[2], self.r)}, " \
            f"A {round(abc[0], self.r)}, B {round(abc[1], self.r)}, C {round(abc[2], self.r)}"

        self.code.append("\n;------- Initialization ---------")
        self.code.append("BAS(#INITMOV,0)")
        self.code.append(f"BAS(#VEL_CP, {self.vel_cp})  ;Continous Path velocity (m/s)")
        self.code.append(f"BAS(#VEL_PTP, {self.vel_ptp})  ;Point-to-point movement velocity (%)")
        self.code.append(f"BAS(#TOOL,{self.tool})   ;setting the tool number")
        self.code.append(f"$BASE = {{POS: {g}}}   ;setting of the base coordinate system")
        self.code.append(f"$ADVANCE = {self.advance}   ;setting of the advance run look ahead amount")
        self.code.append(f"HOME = {self.home}")

    def main(self, p, speed, cont_mode):
        self.code.append("\n;----------- Main section ----------")
        self.code.append("PTP HOME")

        for i in range(p.BranchCount):
            planes = p.Branches[i]
            for j, plane in enumerate(planes):
                pt = self.get_xyz(plane)
                abc = self.get_abc(plane)

                g = f"X {round(pt[0], self.r)}, Y {round(pt[1], self.r)}, Z {round(pt[2], self.r)}, " \
                    f"A {round(abc[0], self.r)}, B {round(abc[1], self.r)}, C {round(abc[2], self.r)}"
                if speed:
                    vel = round(speed[j], 2)
                if iSpeed:
                    self.code.append(f"BAS(#VEL_CP, {vel})")
                if iCont:
                    self.code.append(f"LIN {{POS: {g}}}" + cont_mode)
                else:
                    self.code.append(f"LIN {{POS: {g}}}")

    def footer(self):
        self.code.append("PTP HOME")
        self.code.append("END")

    @property
    def code_list(self):
        return self.code

    @staticmethod
    def get_xyz(plane):
        return plane.Origin

    @staticmethod
    def get_abc(plane):
        ref_plane = plane.WorldXY
        ref_plane.origin = plane.Origin

        abc = [0, 0, 0]

        # Rotation around z-axis
        a = rg.Vector3d.VectorAngle(ref_plane.XAxis, plane.XAxis, ref_plane)
        #a = ref_plane.vector_angle(plane.x_axis, ref_plane)
        if a > math.pi:
            a -= 2 * math.pi
        ref_plane.Rotate(a, ref_plane.ZAxis)
        abc[0] = math.degrees(a)

        # Rotation around y-axis
        ref_y = rg.Plane(ref_plane.Origin, ref_plane.XAxis, -ref_plane.ZAxis)
        #b = ref_plane.vector_angle(plane.x_axis, ref_y)
        b = rg.Vector3d.VectorAngle(ref_plane.XAxis, plane.XAxis, ref_y)
        if b > math.pi:
            b -= 2 * math.pi
        ref_plane.Rotate(b, ref_plane.YAxis)
        abc[1] = math.degrees(b)

        # Rotation around x-axis
        ref_z = rg.Plane(ref_plane.Origin, ref_plane.YAxis, ref_plane.ZAxis)
        #c = ref_plane.vector_angle(plane.y_axis, ref_z)
        c = rg.Vector3d.VectorAngle(ref_plane.YAxis, plane.YAxis, ref_z)
        if c > math.pi:
            c -= 2 * math.pi
        ref_plane.Rotate(c, ref_plane.YAxis)
        abc[2] = math.degrees(c)

        return abc


# Main Script 

# Step 1: create a new KRL code object
krl = KRLCode(iSettings)

# Step 2: generate the header
krl.header()

# Step 3: generate the declaration
krl.decl()

# Step 4: initialization section
krl.init()

# Step 5: main program
krl.main(iPlanes, iSpeed, iCont)

# Step 6: generate the footer
krl.footer()

a = krl.code_list
# ---------- end krl_generation ----------
status = Panel(krl_generation.out)
krl = Panel(krl_generation.a)

data_3 = Data(remap.Clipped)

pt_16 = Point(Point(1703.112037, 25.90127308, 991.8385395))
conoid = ConoidSurface(
    UDivisions=100,
    VDivisions=100,
    RParameter=Slider(8.62, range=0..10),
    TParameter=Slider(3, range=0..10),
    Scale="100",
    Domain1=Domain(-4.838052687, 4.838052687),
    Domain2=Domain(-1.570796327, 1.570796327))
panel_27 = Panel("""0
1""")
pt_17 = ConstructPoint(XCoordinate=panel_27, YCoordinate=0, ZCoordinate=0)
# TOOL PATH GENERATION
geometry_2 = Geometry(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)
xy_10 = XYPlane(Origin=Point(0, 0, 0))

vec_4 = VectorXYZ(XComponent=Slider(45, range=-180..180), YComponent=Slider(-45, range=-180..180), ZComponent=Slider(0, range=-180..180))  # -> Vector, Length
panel_28 = Panel(vec_4.Vector)
sframe_4 = SetFrame(XYZLocation=pt_16, ABCOrientation=vec_4.Vector)

orient_4 = Orient(Geometry=conoid, Source=PlaneXY(0, 0, 0), Target=sframe_4)  # -> Geometry, Transform
iso_2 = IsoCurve(Surface=reparameterize(orient_4.Geometry), UVPoint=pt_17)  # -> UIsocurve, VIsocurve
divide_5 = DivideCurve(Curve=iso_2.VIsocurve, Count=Slider(101, range=1..101), Kinks=False)  # -> Points, Tangents, Parameters
bang_2 = ExplodeTree(Data=divide_5.Points)  # -> Branch0, Branch1
ln_3 = Line(StartPoint=bang_2.Branch0, EndPoint=bang_2.Branch1)
dispatch_2 = Dispatch(List=flatten(ln_3), DispatchPattern=[True, False])  # -> ListA, ListB
flip = FlipCurve(Curve=dispatch_2.ListB)  # -> Curve, Flag
weave = Weave(Pattern=[0, 1], Stream0=dispatch_2.ListA, Stream1=flip.Curve, NullGaps=False)
end_6 = EndPoints(Curve=weave)  # -> Start, End
weave_2 = Weave(Pattern=[0, 1], Stream0=end_6.Start, Stream1=end_6.End, NullGaps=False)
yz_plane = YZPlane(Origin=weave_2)
vec2pt_5 = Vector2Pt(PointA=xy_10, PointB=weave_2, Unitize=False)  # -> Vector, Length
pline_7 = PolyLine(Vertices=yz_plane, Closed=False)
align_2 = AlignPlane(Plane=yz_plane, Direction=vec2pt_5.Vector)  # -> Plane, Angle
len_4 = Length(Curve=pline_7)
preview_11 = CustomPreview(Geometry=pline_7, Shader=ColourSwatch(SwatchColor=RGB(90, 216, 230)))
length_of_tool_path_mm = Panel(len_4)

viewer_3 = ParamViewer(orient_4.Geometry)
viewer_4 = ParamViewer(divide_5.Points)
panel_29 = Panel(divide_5.Points)
panel_30 = Panel(ln_3)
preview_12 = CustomPreview(
    Geometry=bang_2.Branch1,
    Material={diffuse=RGB(228, 178, 227), emission=RGB(68, 53, 68), shine=0.5, specular=RGB(255, 254, 254), transparency=0})
preview_13 = CustomPreview(
    Geometry=bang_2.Branch0,
    Material={diffuse=RGB(228, 178, 227), emission=RGB(68, 53, 68), shine=0.5, specular=RGB(255, 254, 254), transparency=0})
panel_31 = Panel(bang_2.Branch0)
panel_32 = Panel(dispatch_2.ListA)
panel_33 = Panel(dispatch_2.ListB)
panel_34 = Panel(weave)
pline_8 = PolyLine(Vertices=weave_2, Closed=False)
crv_cp = CurveClosestPoint(Point=weave_2, Curve=pline_8)  # -> Point, Parameter, Distance
eval = EvaluateCurve(Curve=pline_8, Parameter=crv_cp.Parameter)  # -> Point, Tangent, Angle
panel_35 = Panel(align_2.Plane)

dat = Panel("""&ACCESS RVO
&REL 4

ENDDAT""")  # disabled
panel_36 = Panel("DEFDAT ")  # disabled
panel_37 = Panel(" PUBLIC")  # disabled
concatenate = Concatenate(Fragment_A=panel_36, A=panel_37)  # disabled

insert_items = InsertItems(List=dat, Item=concatenate, Indices=2, Wrap=True)  # disabled

dat_2 = Panel(insert_items)  # disabled

python_3_script_3 = Python3Script(iFilePath=panel_19, iEnabled=enable, iExport=export, iSRC=krl, iDAT=dat_2)  # -> out, a; inputs iFilePath: String, iEnabled: Boolean, iExport: Boolean, iSRC: list of String, iDAT: list of String
# ---------- python_3_script_3: Python ----------
import rhinoscriptsyntax as rs
import os
import Grasshopper.Kernel as gh

srcPath = (iFilePath + ".src")
datPath = (iFilePath + ".dat")
if iExport and iEnabled:
    fileName = open(srcPath, 'w')
    for line in iSRC:
        fileName.write( line + '\n')
    fileName.close()
if iExport and iEnabled:
    fileName = open(datPath, 'w')
    for line in iDAT:
        fileName.write( line + '\n')
    fileName.close()
# ---------- end python_3_script_3 ----------

# ==== cluster Cluster
pt = ClusterInput()
num = ClusterInput()
num_2 = Number(simplify(graft(num)))
bang = ExplodeTree(Data=simplify(graft(num_2)))  # -> Branch0, Branch1, Branch2, Branch3, Branch4, Branch5
remap = RemapNumbers(Value=bang.Branch3, Source="-360 To 360", Target=Domain(0, 1))  # -> Mapped, Clipped
remap_2 = RemapNumbers(Value=bang.Branch0, Source="-185 To 185", Target=Domain(0, 1))  # -> Mapped, Clipped
remap_3 = RemapNumbers(Value=bang.Branch1, Source="-120 To 70", Target=Domain(0, 1))  # -> Mapped, Clipped
remap_4 = RemapNumbers(Value=bang.Branch2, Source="-120 To 155", Target=Domain(0, 1))  # -> Mapped, Clipped
remap_5 = RemapNumbers(Value=bang.Branch4, Source="-125 To 125", Target=Domain(0, 1))  # -> Mapped, Clipped
remap_6 = RemapNumbers(Value=bang.Branch5, Source="-360 To 360", Target=Domain(0, 1))  # -> Mapped, Clipped
pt_2 = Point([Point(2414.044296, -2835.36217, -1950), Point(2414.044296, -3801.914806, -1950)])
dedomain = DeconstructDomain(Domain="-185 To 185")  # -> Start, End
dedomain_2 = DeconstructDomain(Domain="-120 To 70")  # -> Start, End
dedomain_3 = DeconstructDomain(Domain="-125 To 125")  # -> Start, End
dedomain_4 = DeconstructDomain(Domain="-120 To 155")  # -> Start, End
dedomain_5 = DeconstructDomain(Domain="-360 To 360")  # -> Start, End
dedomain_6 = DeconstructDomain(Domain="-360 To 360")  # -> Start, End
item = ListItem(List=pt_2, Index=0, Wrap=True)  # -> Item, Item1
pt_3 = Point(pt)
X = UnitX(Factor=expr("X*10", [dedomain_3.Start, dedomain_3.End]))
X_2 = UnitX(Factor=expr("X*10", [dedomain_4.Start, dedomain_4.End]))
X_3 = UnitX(Factor=expr("x*10", [dedomain_2.Start, dedomain_2.End]))
X_4 = UnitX(Factor=expr("X*10", [dedomain_5.Start, dedomain_5.End]))
X_5 = UnitX(Factor=expr("x*10", [dedomain.Start, dedomain.End]))
X_6 = UnitX(Factor=expr("X*10", [dedomain_6.Start, dedomain_6.End]))
vec2pt = Vector2Pt(PointA=item.Item, PointB=item.Item1, Unitize=False)  # -> Vector, Length
line = LineSDL(Start=pt_3, Direction=vec2pt.Vector, Length=vec2pt.Length)
crv = Curve(line)
divide = DivideCurve(Curve=crv, Count=Slider(5, range=0..10), Kinks=False)  # -> Points, Tangents, Parameters
entwine = Entwine(Branch00=X_5, Branch01=X_3, Branch02=X_2, Branch03=X_4, Branch04=X, Branch05=X_6, FlattenInputs=True)
move = Move(Geometry=graft(divide.Points), Motion=entwine)  # -> Geometry, Transform
item_2 = ListItem(List=move.Geometry, Index=0, Wrap=True)
item_3 = ListItem(List=move.Geometry, Index=Slider(1, range=0..1), Wrap=True)
entwine_2 = Entwine(
    Branch00=remap_2.Mapped,
    Branch01=remap_3.Mapped,
    Branch02=remap_4.Mapped,
    Branch03=remap.Mapped,
    Branch04=remap_5.Mapped,
    Branch05=remap_6.Mapped,
    FlattenInputs=True)
gradient = Gradient(
    LowerLimit=0,
    UpperLimit=1,
    Parameter=entwine_2,
    stops=[0: RGB(255, 0, 0), 0.25: RGB(255, 255, 0), 0.5: RGB(0, 128, 0), 0.75: RGB(255, 255, 0), 1: RGB(255, 0, 0)])
python_script = PythonScript(x=flatten(num_2))  # -> out, simplify(graft(a)), b
# ---------- python_script: Python ----------
if x>0: 
    a = 1
    b = 50 
else: 
    a = 3
    b = -50
# ---------- end python_script ----------
ln = Line(StartPoint=item_2, EndPoint=item_3)
number_slider = Slider(127, range=0..300)
eval = EvaluateCurve(Curve=reparameterize(simplify(ln)), Parameter=entwine_2)  # -> simplify(Point), Tangent, Angle
llx = LineLine(Line1=crv, Line2=ln)  # -> ParamA, ParamB, PointA, PointB
unit_x = UnitX(Factor=python_script.b)  # -> graft(UnitVector)
line_2 = Line(simplify(ln))
neg = Negative(Value=number_slider)
Y = UnitY(Factor=Slider(100, range=0..100))
Y_2 = UnitY(Factor=number_slider)
pt_4 = Point(eval.Point)
panel = Panel(python_script.a)
move_2 = Move(Geometry=llx.PointA, Motion=Y)  # -> simplify(Geometry), Transform
pt_5 = Point([eval.Point, move_2.Geometry])
addition = Addition(A=Y_2, B=unit_x)
bbox = BoundingBox(Content=pt_5, Plane=PlaneXY(0, 0, 0), UnionBox=True)  # -> Box, Box_2
move_3 = Move(Geometry=pt_4, Motion=addition)  # -> Geometry, Transform
colour = ClusterOutput(gradient)
a = ClusterOutput(python_script.a)
unit_y = UnitY(Factor=Slider(26, range=0..100))
tag = TextTag(Location=move_3.Geometry, Text=num_2)
G = ClusterOutput(move_3.Geometry)
line_3 = ClusterOutput(line_2)
crv_2 = ClusterOutput(crv)
move_4 = Move(Geometry=bbox.Box, Motion=unit_y)  # -> Geometry, Transform
geometry = ClusterOutput(move_4.Geometry)

# ==== cluster Cluster_2
geo = Geometry(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)  # disabled
geo_2 = Geometry([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])  # disabled
geo_3 = Geometry(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)  # disabled
geo_4 = Geometry([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])  # disabled
geo_5 = Geometry(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)  # disabled
geo_6 = Geometry(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)  # disabled
geo_7 = Geometry(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)  # disabled
xy = XYPlane(Origin=Point(0, 0, 0))
pln = Plane(PlaneXY(0, 0, 0))
pln_2 = Plane(PlaneXZ(350, 0, 815))
pln_3 = Plane(PlaneXZ(350, 0, 1665))
pln_4 = Plane(PlaneYZ(815, 0, 1810))
pln_5 = Plane(PlaneXZ(1170, 0, 1810))
pln_6 = Plane(PlaneYZ(1340, 0, 1810))
mesh = Mesh(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)
mesh_2 = Mesh([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])
mesh_3 = Mesh(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)
mesh_4 = Mesh([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])
mesh_5 = Mesh(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)
mesh_6 = Mesh(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)
mesh_7 = Mesh(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)
robroot = ClusterInput()
end_effector = ClusterInput()
kuka_robot = Define6AxisKUKARobot(
    Axis1PivotPoint=pln,
    Axis2PivotPoint=pln_2,
    Axis3PivotPoint=pln_3,
    Axis4PivotPoint=pln_4,
    Axis5PivotPoint=pln_5,
    Axis6PivotPoint=pln_6,
    BaseGeometry=mesh,
    Axis1Geometry=mesh_2,
    Axis2Geometry=mesh_3,
    Axis3Geometry=mesh_4,
    Axis4Geometry=mesh_5,
    Axis5Geometry=mesh_6,
    Axis6Geometry=mesh_7,
    RobRootFrame=robroot,
    EndEffector=end_effector)
robot = ClusterOutput(kuka_robot)

# ==== cluster SrfSmallLarge
srf_list = ClusterInput()
edges = BrepEdges(Brep=srf_list)  # -> Naked, Interior, NonManifold
len = Length(Curve=edges.Naked)
ma = MassAddition(Input=len)  # -> Result, PartialResults
pshift = ShiftPaths(Data=ma.Result, Offset=-1)
sort = SortList(Keys=pshift, ValuesA=srf_list)  # -> Keys, ValuesA
item = ListItem(List=reverse(sort.ValuesA), Index=0, Wrap=True)
item_2 = ListItem(List=sort.ValuesA, Index=0, Wrap=True)
smallest = ClusterOutput(item_2)
largest = ClusterOutput(item)
