# Grasshopper definition dolha_darius-ma_5.gh (Grasshopper 1.0.8)

# ----
# Task 1: WRITE A FUNCTION THAT turns an input curve into a list of N
# lines (i.e. visually these lines should form a
# polyline that approximate the original input curve)
# 
# (Hint: You can set the curve's interval to
#  the range 0.0 - 1.0 to make the math a bit
# easier to work with)
# Task 2: (Optional) Try out various functions and properties in the Points, Vectors, and Curves class.
# 
# This task is supposed to get you a bit more familiar with these RhinoCommon features.
# 
# A possible exercise: Use script to visualise the curvature of  different curves
# Task 3: Use what you have learnt so far to generate a geometric design. BE CREATIVE  !
# 
# You must use Curves, Points, Planes, or Curve or a combination of these.
panel = Panel("10")
# Assignment
crv = Curve(<curve referenced from the Rhino model>)
python = GhPythonScript(iCurve=crv, iN=panel)  # -> out, a, b; inputs iCurve: Curve, iN: Int32
# ---------- python: Python ----------
import Rhino.Geometry as rg 

def curve_to_lines(iCurve, n):
    """
    Convert a curve into N straight line segments.
    Returns a list of rg.Line objects.
    """
    if iCurve is None or n < 2:
        return []

    iCurve.Domain = rg.Interval(0.0, 1.0)

    t0=iCurve.Domain.T0
    t1=iCurve.Domain.T1

    pts = []
    lines = []
    for i in range(n + 1):
        t = t0 + (t1 - t0) * (i / float(n))   
        pts.append(iCurve.PointAt(t))
        #PointAt(t) evaluates the curve at parameter t, returning a Point3d object
    
    # Build lines
    for i in range(n):
        lines.append(rg.Line(pts[i], pts[i+1]))
         #Line(start, end) creates a straight line segment between two points.
    
    
    return (lines,pts)

result=curve_to_lines(iCurve,iN)
a=result[0]
b=result[1]
print("done")
# ---------- end python ----------

pt = Point(python.b)
crv_2 = Curve(python.a)
cp = ControlPoints(Curve=python.a)  # -> Points, Weights, Knots
panel_2 = Panel(python.a)
panel_3 = Panel(python.out)
S = Script(x=Slider(18, range=10..20), y=Slider(4, range=1..4))  # -> out, a, b
# ---------- S: Python ----------
import Rhino.Geometry as rg
import math

# INPUTS
num_curves = 24         # number of curves in the ribbon
points_per_curve = 52   # points along each curve
curve_length = x       # height of the ribbon
twist_factor = 2        # how much the ribbon twists
amplitude = y           # sine wave amplitude
lines = []
curves = []

# creatw twisted curves
for i in range(num_curves):
    curve_pts = []
    for j in range(points_per_curve):
        t = j / float(points_per_curve - 1)  # normalized [0,1]
        x = i * 3  # spacing between curves
        y = math.sin(t * math.pi * twist_factor + i) * amplitude
        z = t * curve_length
        curve_pts.append(rg.Point3d(x, y, z))
    #create a polyline curve through the points
    crv = rg.Curve.CreateInterpolatedCurve(curve_pts,3)
    curves.append(crv)
    
    #connect consecutive points with lines for a mesh-like effect
    for k in range(len(curve_pts) - 1):
        lines.append(rg.Line(curve_pts[k], curve_pts[k+1]))
    #the NURBS can be seen when zooming in!!!

# OUTPUT
a = curves  # the twisting ribbon curves
b = lines   # optional connecting lines
print("ok")
# ---------- end S ----------
panel_4 = Panel(S.b)
panel_5 = Panel(S.out)
nurbs_curve = Curve(S.b)
panel_6 = Panel(S.a)
crv_3 = Curve(S.a)
